# Grasshopper definition testing.gh (Grasshopper 1.0.8)

path = FilePath("/Users/devonperoutky/Development/projects/3d-photo/grasshopper_scripts/gaussiansplat_to_model.py")
txt = Text("preview")
path_2 = FilePath("/Users/devonperoutky/Development/projects/3d-photo/assets/JAPAN_test.ply")
file = ReadFile(File=path, PerLineParse=False)
py3 = Python3Script(
    script=file,
    file_path=path_2,
    scale_factor=Slider(1.381, range=1..3),
    subdivision_level=Slider(7.309, range=2..16),
    sample_percentage=Slider(1, range=0..1),
    render_mode=txt)  # -> out, geometries, colors; inputs file_path: String; unedited script template
panel = Panel(file)
panel_2 = Panel(py3.out)
panel_3 = Panel(py3.colors)
preview = CustomPreview(Geometry=py3.geometries, Material=py3.colors)
panel_4 = Panel(py3.geometries)
